# Dynamo custom node AllElementsInProject.dyf (Dynamo 1.3.3.4111)
# category: AKP Tools.Selection
# Returns All Elements In Project

GetAllElements = Input(GetAllElements:bool=false)
all_elements = Python(IN[0]=GetAllElements)  # unwired: IN[1]
# ---------- all_elements.python (48 lines) ----------
import clr
clr.AddReference('ProtoGeometry')
from Autodesk.DesignScript.Geometry import *
# Import ToDSType(bool) extension method
clr.AddReference("RevitNodes")
import Revit
clr.ImportExtensions(Revit.Elements)
# Import geometry conversion extension methods
clr.ImportExtensions(Revit.GeometryConversion)
# Import DocumentManager and TransactionManager
clr.AddReference("RevitServices")
import RevitServices
from RevitServices.Persistence import DocumentManager
from RevitServices.Transactions import TransactionManager
from System.Collections.Generic import *
# Import RevitAPI
clr.AddReference("RevitAPI")
import Autodesk
from Autodesk.Revit.DB import *

doc = DocumentManager.Instance.CurrentDBDocument
uiapp = DocumentManager.Instance.CurrentUIApplication
app = uiapp.Application



coll = FilteredElementCollector(doc)



check = IN[0]

# Start Transaction
TransactionManager.Instance.EnsureInTransaction(doc)

if check == True:

		elementCollector = coll.WhereElementIsNotElementType().ToElements()
		
else:

	null

TransactionManager.Instance.TransactionTaskDone()



OUT=elementCollector
# ----------------------------------------
AllElements = Output(all_elements)
