# Dynamo custom node Centroid.dyf (Dynamo 1.3.2.2480)
# category: AKP Tools.Geometry
# Gets the Centroid of Compound Objects

SelectFirstElement = Input()  # Select the first element of the Compound Objects
SelectSecondElement = Input()  # Select the Second element of the Compound Objects

# group: Get Geometry
geometry = Element.Geometry(SelectFirstElement)
geometry_2 = Element.Geometry(SelectSecondElement)

union = Solid.Union(geometry, geometry_2)
centroid = Solid.Centroid(union)
Centroid = Output(centroid)  # Centroid point
COGFamily = Input()  # Select the Centroid Family to be placed at the Centroid Point
byPoint = FamilyInstance.ByPoint(familyType=COGFamily, point=centroid)
COGFamily_2 = Output(byPoint)  # "COGFamily"
