# Dynamo custom node CollectorByType.dyf (Dynamo 1.3.3.4111)
# category: AKP Tools.Selection
# Selects All Elements of Type in Project

ElementType = Input()  # Element Type to be Selected
SelectElements = Input(SelectElements:bool = false)  # Select Elements in View
python_script = Python(IN[0]=ElementType, IN[1]=SelectElements)
# ---------- python_script.python (69 lines) ----------
import clr

clr.AddReference('RevitAPI')
from Autodesk.Revit.DB import *
from Autodesk.Revit.DB.Structure import *

clr.AddReference('RevitAPIUI')
from Autodesk.Revit.UI import *

clr.AddReference('System')
from System.Collections.Generic import List

clr.AddReference('RevitNodes')
import Revit
clr.ImportExtensions(Revit.GeometryConversion)
clr.ImportExtensions(Revit.Elements)

clr.AddReference('RevitServices')
import RevitServices
from RevitServices.Persistence import DocumentManager
from RevitServices.Transactions import TransactionManager

doc = DocumentManager.Instance.CurrentDBDocument
uidoc=DocumentManager.Instance.CurrentUIApplication.ActiveUIDocument
uiapp = DocumentManager.Instance.CurrentUIApplication
app = uiapp.Application


select = []
uisel = uidoc.Selection
result = []

type = IN[0]

selectelements = IN[1]

#Preparing input from dynamo to revit

collector = FilteredElementCollector(doc)

#Do some action in a Transaction
TransactionManager.Instance.EnsureInTransaction(doc)



Selectedtype = collector.OfClass(type).ToElements()

if selectelements == True:

	for i in Selectedtype:
	
		select.append(i.Id)
		Icollection = List[ElementId](select)
		uisel.SetElementIds(Icollection)
		result.append("Seccess")
		
	else:

		result=null




		
				
TransactionManager.Instance.TransactionTaskDone()


OUT = Selectedtype
# ----------------------------------------
Elements = Output(python_script)  # List Of Elements in Project
