# Dynamo custom node ContactMe.dyf (Dynamo 1.3.3.4111)
# category: AKP Tools.Info
# Contact me on linkedin

Launch = Input(Launch:bool=false)  # Set True to launch website in your default browser!
python_script = Python(IN[0]=Launch)  # unwired: IN[1]
# ---------- python_script.python (25 lines) ----------
import clr

from System.Diagnostics import Process


status = "Success!! Login Linkedin first"



if IN[0] == 1:

	try:

		x = Process.Start('https://www.linkedin.com/in/ashwinkumarp/')
	
	except:

		status = "Default browser not set!!!"
		
else:

	status = " RunIt "
	
	
OUT = status
# ----------------------------------------
Status = Output(python_script)
