# Dynamo custom node Create Worksets.dyf (Dynamo 1.3.2.2480)
# category: AKP Tools.General
# Create Worksets From Given List

WorksetNames = Input()  # Name of Worksets to be Created
create_worksets = Python(IN[0]=WorksetNames)
# ---------- create_worksets.python (42 lines) ----------
import clr

clr.AddReference('RevitAPI')
from Autodesk.Revit.DB import *
from Autodesk.Revit.DB.Structure import *


clr.AddReference('RevitNodes')
import Revit
clr.ImportExtensions(Revit.GeometryConversion)
clr.ImportExtensions(Revit.Elements)

clr.AddReference('RevitServices')
import RevitServices
from RevitServices.Persistence import DocumentManager
from RevitServices.Transactions import TransactionManager
from System.Collections.Generic import *

clr.AddReference("RevitAPI")
import Autodesk
from Autodesk.Revit.DB import *

doc = DocumentManager.Instance.CurrentDBDocument
view = doc.ActiveView


WorksetName = IN[0]

TransactionManager.Instance.EnsureInTransaction(doc)

for i in WorksetName:
		
		NewWorkset = Workset.Create(doc,i)
		


TransactionManager.Instance.TransactionTaskDone()			

		
		
	
OUT = NewWorkset
# ----------------------------------------
Worksets = Output(create_worksets)  # Worksets Created
