# Dynamo custom node DeleteAll Sheets&Views.dyf (Dynamo 1.3.2.2480)
# category: AKP Tools.General
# Deletes All Sheets,Views, Schedules And Legends

Delete = Input(Delete:bool=False)
delete_sh_vs_s = Python(IN[0]=Delete)  # unwired: IN[1]
# ---------- delete_sh_vs_s.python (78 lines) ----------
import clr
clr.AddReference('ProtoGeometry')
from Autodesk.DesignScript.Geometry import *
# Import ToDSType(bool) extension method
clr.AddReference("RevitNodes")
import Revit
clr.ImportExtensions(Revit.Elements)
# Import geometry conversion extension methods
clr.ImportExtensions(Revit.GeometryConversion)
# Import DocumentManager and TransactionManager
clr.AddReference("RevitServices")
import RevitServices
from RevitServices.Persistence import DocumentManager
from RevitServices.Transactions import TransactionManager
from System.Collections.Generic import *
# Import RevitAPI
clr.AddReference("RevitAPI")
import Autodesk
from Autodesk.Revit.DB import *

doc = DocumentManager.Instance.CurrentDBDocument
uiapp = DocumentManager.Instance.CurrentUIApplication
app = uiapp.Application

delete = IN[0]

cantdelete=[]

coll = FilteredElementCollector(doc)

views = coll.OfClass(View).ToElements()

sheets = coll.OfClass(ViewSheet).ToElements()


viewelt = []
for i in views:
	viewelt.append(UnwrapElement(i).Id)
	
	
sheetselts = []
for i in sheets:
	sheetselts.append(UnwrapElement(i).Id)
		
	

# Start Transaction
TransactionManager.Instance.EnsureInTransaction(doc)


if delete == True:

	cantdelete=[]
	for item in viewelt:
		try:
			doc.Delete(item)
		except:
			cantdelete.append(item)
		
		
	cantdelete=[]
	for item in sheetselts:
		try:
			doc.Delete(item)
		except:
			cantdelete.append(item)
			
else:

	null = 0
		

# End Transaction
TransactionManager.Instance.TransactionTaskDone()

doc.Regenerate()

OUT=cantdelete
# ----------------------------------------
NotDeleted = Output(delete_sh_vs_s)
