# Dynamo custom node DimensionIsOverridenInView.dyf (Dynamo 1.3.3.4111)
# category: AKP Tools.QA
# Checks for overriden dimensions in view

RunIt = Input(RunIt:bool = false)
python_script = Python(IN[0]=RunIt)
# ---------- python_script.python (75 lines) ----------
#Ashwin Kumar

import clr
clr.AddReference('ProtoGeometry')
clr.AddReference("RevitNodes")
clr.AddReference("RevitServices")
clr.AddReference("RevitAPI")
import Revit
import System
import RevitServices
import Autodesk
from Revit.Elements import *
from Autodesk.DesignScript.Geometry import *
from Autodesk.Revit.DB import *
from RevitServices.Persistence import DocumentManager
from RevitServices.Transactions import TransactionManager
clr.ImportExtensions(Revit.Elements)
clr.ImportExtensions(Revit.GeometryConversion)

doc = DocumentManager.Instance.CurrentDBDocument
uiapp = DocumentManager.Instance.CurrentUIApplication
app = uiapp.Application

coll = FilteredElementCollector(doc,doc.ActiveView.Id)

dimsinview = coll.OfCategory(BuiltInCategory.OST_Dimensions).ToElements()


dimensions = UnwrapElement(dimsinview)

overriden = []

status = "Success"

#transaction
TransactionManager.Instance.EnsureInTransaction(doc)

if IN[0] == 1:

	for dims in dimensions:

		if dims.NumberOfSegments ==0:
	
			sval=dims.ValueOverride;
			
			if not sval:
	
				continue

			else:
				
				overriden.append(dims);
				
		else:

			for j in dims.Segments:
	
				val=j.ValueOverride;
			
				if not val:
	
					continue

				else:
				
					overriden.append(dims);
			
else:

	status = "RunIt"

TransactionManager.Instance.TransactionTaskDone()

#Assign your output to the OUT variable.
OUT = overriden,status
# ----------------------------------------
code_block = CodeBlock(x=python_script) { x[0]; x[1]; }
code_block_2 = CodeBlock { 255; }
byARGB = Color.ByARGB(r=code_block_2)
overrideColorInView = Element.OverrideColorInView(element=code_block.out0, color=byARGB)
Dimensions = Output(code_block.out0)
Status = Output(code_block.out1)
