# Dynamo custom node DuplicateTagCheck.dyf (Dynamo 1.3.3.4111)
# category: AKP Tools.Rebar
# Checks Views for Duplicate Tags

ChangeColor = Input(ChangeColor:bool)  # changes color of duplicates

# group: 1.Check Duplicates
python_script = Python()  # unwired: IN[0], IN[1]
# ---------- python_script.python (95 lines) ----------
import clr

clr.AddReference('RevitAPI')
from Autodesk.Revit.DB import *
from Autodesk.Revit.DB.Structure import *

clr.AddReference('RevitNodes')
import Revit
clr.ImportExtensions(Revit.GeometryConversion)
clr.ImportExtensions(Revit.Elements)

clr.AddReference('RevitServices')
import RevitServices
from RevitServices.Persistence import DocumentManager
from RevitServices.Transactions import TransactionManager

doc = DocumentManager.Instance.CurrentDBDocument

coll = FilteredElementCollector(doc,doc.ActiveView.Id)

tagsinview = coll.OfCategory(BuiltInCategory.OST_RebarTags).ToElements()

elements = []

duptags = []

dupeles = []

dupdims = []

rebar = []


for t in tagsinview:

	id = t.TaggedLocalElementId
	element = doc.GetElement(id)
# if tag is a multi tag gets element id of dimension family then gets the rebar element assocaited with the dimension family and adds to list

	if element.GetType().ToString() == "Autodesk.Revit.DB.Dimension":
		uId = set([r.ElementId for r in element.References])
		
		for ui in uId:
			
			elements.append(ui)
	else:
# if tag not multi tag direclty adds rebar to list
			elements.append(element.Id)


for e in elements:

	
	y = elements.count(e)
	
	if y > 1:

		dupeles.append(e)
		
	else:
	
		pass

for t in tagsinview:

	id = t.TaggedLocalElementId
	element = doc.GetElement(id)

	if element.GetType().ToString() == "Autodesk.Revit.DB.Dimension":
		rebarId = set([r.ElementId for r in element.References])
		
		for ids in rebarId:
		
			if ids in dupeles:
			
				duptags.append(t)	
				dupdims.append(element)
			
	else: 
		srebarId = set([element.Id])
		
		for ids in srebarId:
		
			if ids in dupeles:
			
				duptags.append(t)
		
for ele in dupeles:

	rebar.append(doc.GetElement(ele).ToDSType(True))
		

OUT = rebar,duptags,dupdims
			
			
# ----------------------------------------

code_block = CodeBlock(x=python_script) { Flatten(x); }

# group: Change Color
code_block_2 = CodeBlock { ""; }
if_ = If(test=ChangeColor, true=code_block, false=code_block_2)
code_block_3 = CodeBlock { DSCore.Color.ByARGB(255,255,0,0); }
overrideColorInView = Element.OverrideColorInView(element=if_, color=code_block_3)

SelectInView = Input(SelectInView:bool)  # Selects elements in view

# group: Select Elements
code_block_4 = CodeBlock { ""; }
if_2 = If(test=SelectInView, true=code_block, false=code_block_4)
select_elements = Python(IN[0]=if_2)  # unwired: IN[1]
# ---------- select_elements.python (36 lines) ----------
import clr
clr.AddReference('ProtoGeometry')
from Autodesk.DesignScript.Geometry import *
# Import ToDSType(bool) extension method
clr.AddReference("RevitNodes")
import Revit
clr.ImportExtensions(Revit.Elements)
# Import geometry conversion extension methods
clr.ImportExtensions(Revit.GeometryConversion)
# Import DocumentManager and TransactionManager
clr.AddReference("RevitServices")
import RevitServices
from RevitServices.Persistence import DocumentManager
from RevitServices.Transactions import TransactionManager
from System.Collections.Generic import *
import System.Object
# Import RevitAPI
clr.AddReference("RevitAPI")
import Autodesk
from Autodesk.Revit.DB import *

doc = DocumentManager.Instance.CurrentDBDocument
uiapp = DocumentManager.Instance.CurrentUIApplication
app = uiapp.Application
uidoc=DocumentManager.Instance.CurrentUIApplication.ActiveUIDocument

input = UnwrapElement(IN[0])
elt=[]
for i in input:
	elt.append(i.Id)

collection = List[ElementId](elt)

uidoc.Selection.SetElementIds(collection)

OUT = input
# ----------------------------------------

Elements = Output(code_block)
