# Dynamo custom node Element Parameters by Group.dyf (Dynamo 1.3.3.4111)
# category: AKP Tools.General
# Filters the element parameters by Parameter group

Element = Input()  # List of elements to be read
GroupName = Input()  # Name of parameter group Eg. PG_TEXT..etc
python_template = Python(IN[0]=Element, IN[1]=GroupName)
# ---------- python_template.python (64 lines) ----------
# ashwin kumar
import clr
clr.AddReference('ProtoGeometry')
clr.AddReference("RevitNodes")
clr.AddReference("RevitServices")
clr.AddReference("RevitAPI")
import Revit
import System
import RevitServices
import Autodesk
from Revit.Elements import *
from Autodesk.DesignScript.Geometry import *
from Autodesk.Revit.DB import *
from RevitServices.Persistence import DocumentManager
from RevitServices.Transactions import TransactionManager
clr.ImportExtensions(Revit.Elements)
clr.ImportExtensions(Revit.GeometryConversion)

doc = DocumentManager.Instance.CurrentDBDocument



TransactionManager.Instance.EnsureInTransaction(doc)

elem = UnwrapElement(IN[0])

vparams = []

vparamvalue = []

pgroup = IN[1]


for e in elem:

	allparams = e.Parameters

	

	for i in allparams:


		try:

			pname = i.Definition.Name
		

			if str(i.Definition.ParameterGroup) == pgroup:
	
	
				vparams.append(pname)
		
				vparamvalue.append(i.AsValueString())
		
				
		except:
	
				continue
		

TransactionManager.Instance.TransactionTaskDone()


OUT = vparams,vparamvalue
# ----------------------------------------
code_block = CodeBlock(x=python_template) { x[0]; }
ParameterName = Output(code_block)
code_block_2 = CodeBlock(x=python_template) { x[1]; }
ParameterValue = Output(code_block_2)
