# Dynamo custom node ElementIsPinnedInView.dyf (Dynamo 1.3.2.2480)
# category: AKP Tools.General
# Returns lists For Pinned and Unpinned Elements in ActiveView

Check = Input(Check:bool=false)
all_elements_in_view = Python(IN[0]=Check)  # unwired: IN[1]
# ---------- all_elements_in_view.python (62 lines) ----------
import clr
clr.AddReference('ProtoGeometry')
from Autodesk.DesignScript.Geometry import *
# Import ToDSType(bool) extension method
clr.AddReference("RevitNodes")
import Revit
clr.ImportExtensions(Revit.Elements)
# Import geometry conversion extension methods
clr.ImportExtensions(Revit.GeometryConversion)
# Import DocumentManager and TransactionManager
clr.AddReference("RevitServices")
import RevitServices
from RevitServices.Persistence import DocumentManager
from RevitServices.Transactions import TransactionManager
from System.Collections.Generic import *
# Import RevitAPI
clr.AddReference("RevitAPI")
import Autodesk
from Autodesk.Revit.DB import *

doc = DocumentManager.Instance.CurrentDBDocument
uiapp = DocumentManager.Instance.CurrentUIApplication
app = uiapp.Application

coll = FilteredElementCollector(doc,doc.ActiveView.Id)

elementsinview = coll.WhereElementIsNotElementType().ToElements()

check = IN[0]

ispinned = []

pinned = []

notpinned = []

# Start Transaction
TransactionManager.Instance.EnsureInTransaction(doc)



if check == True:

	for element in elementsinview:			
			
		if element.Pinned == True:

			pinned.append(element)
		
		else:
		
			notpinned.append(element)
	
else:

	null

TransactionManager.Instance.TransactionTaskDone()



OUT=pinned,notpinned
# ----------------------------------------
code_block = CodeBlock(Pinned=all_elements_in_view) { Pinned[0]; }
PinnedElements = Output(code_block)
code_block_2 = CodeBlock(Notpinned=all_elements_in_view) { Notpinned[1]; }
UnpinnedElements = Output(code_block_2)
