# Dynamo custom node ExportIFC.dyf (Dynamo 1.3.2.2480)
# category: AKP Tools.Revit
# Opens the Export IFC Dialog Box in Revit

RunIt = Input(RunIt:bool=false)  # Opens the Export IFC Dialog in Revit
export_ifc_prompt = Python(IN[0]=RunIt)
# ---------- export_ifc_prompt.python (27 lines) ----------
import clr
clr.AddReference('RevitAPI')
clr.AddReference('RevitAPIUI')
import Autodesk
from Autodesk.Revit.UI import RevitCommandId
from Autodesk.Revit.UI import UIApplication
from Autodesk.Revit.UI import ExternalCommandData
clr.AddReference('RevitServices')
import RevitServices
from RevitServices.Persistence import DocumentManager
from RevitServices.Transactions import TransactionManager

doc = DocumentManager.Instance.CurrentDBDocument
uiapp = DocumentManager.Instance.CurrentUIApplication

RunIt = IN[0] 

if RunIt ==  True:
	CmndID = RevitCommandId.LookupCommandId('ID_EXPORT_IFC')
	CmId = CmndID.Id
	uiapp.PostCommand(CmndID)
	status = 'Success'
else:
	status = 'Fail'

#Assign your output to the OUT variable
OUT = status
# ----------------------------------------
Sucess = Output(export_ifc_prompt)
