# Dynamo custom node GetAllViewsinView.dyf (Dynamo 1.3.3.4111)
# category: AKP Tools.Selection
# Gets all sections,elevations..etc in Active View

RunIt = Input(RunIt:bool=false)  # Set true to run
python_script = Python(IN[0]=RunIt)
# ---------- python_script.python (40 lines) ----------
import clr

clr.AddReference('RevitAPI')
from Autodesk.Revit.DB import *
from Autodesk.Revit.DB.Structure import *

clr.AddReference('RevitAPIUI')
from Autodesk.Revit.UI import *

clr.AddReference('System')
from System.Collections.Generic import List

clr.AddReference('RevitNodes')
import Revit
clr.ImportExtensions(Revit.GeometryConversion)
clr.ImportExtensions(Revit.Elements)

clr.AddReference('RevitServices')
import RevitServices
from RevitServices.Persistence import DocumentManager
from RevitServices.Transactions import TransactionManager

doc = DocumentManager.Instance.CurrentDBDocument
uidoc=DocumentManager.Instance.CurrentUIApplication.ActiveUIDocument


Runit = IN[0]

views = []

if Runit == True:

	v= doc.ActiveView.Id

	collector = FilteredElementCollector(doc,v)

	views = collector.OfCategory(BuiltInCategory.OST_Viewers).ToElements()


OUT = views
# ----------------------------------------
Views = Output(python_script)
