# Dynamo custom node Highlight Untagged Rebar.dyf (Dynamo 1.3.3.4111)
# category: AKP Tools.Rebar
# Highlights Untagged Rebar in Current View

# group: All Elements that should be Tagged
all_elements_in_active_view = ElementsInView()
string_from_object = FromObject(all_elements_in_active_view)
code_block = CodeBlock { "Rebar"; }
eq = string_from_object == code_block
filterByBoolMask = List.FilterByBoolMask(list=all_elements_in_active_view, mask=eq)

code_block_2 = CodeBlock(item=filterByBoolMask.in) { Flatten({item}); }

# group: All Tags
categories = Categories("RebarTags")
all_elements_of_category = ElementsOfCategory(categories)

code_block_3 = CodeBlock(item=all_elements_of_category) { Flatten({item}); }
python_script = Python(IN[0]=code_block_3)
# ---------- python_script.python (47 lines) ----------
import clr
clr.AddReference('ProtoGeometry')
from Autodesk.DesignScript.Geometry import *
# Import ToDSType(bool) extension method
clr.AddReference("RevitNodes")
import Revit
clr.ImportExtensions(Revit.Elements)
# Import geometry conversion extension methods
clr.ImportExtensions(Revit.GeometryConversion)
# Import DocumentManager and TransactionManager
clr.AddReference("RevitServices")
import RevitServices
from RevitServices.Persistence import DocumentManager
from RevitServices.Transactions import TransactionManager
from System.Collections.Generic import *
# Import RevitAPI
clr.AddReference("RevitAPI")
import Autodesk
from Autodesk.Revit.DB import *

doc = DocumentManager.Instance.CurrentDBDocument
uiapp = DocumentManager.Instance.CurrentUIApplication
app = uiapp.Application
uidoc=DocumentManager.Instance.CurrentUIApplication.ActiveUIDocument

elt = []
for i in IN[0]:
	elt.append(UnwrapElement(i))

ids, tags = [], []

# Start Transaction
#TransactionManager.Instance.EnsureInTransaction(doc)


for i in elt:
	if i.TaggedLocalElementId.IntegerValue != -1:
		ids.append(i.TaggedLocalElementId)
		tags.append(i)
	else:
		continue
		

# End Transaction
#TransactionManager.Instance.TransactionTaskDone()

OUT = ids, tags
# ----------------------------------------
code_block_4 = CodeBlock(a=python_script) { a[0]; a[1]; }
uniqueItems = List.UniqueItems(code_block_4.out0)
python_script_2 = Python(IN[0]=code_block_2)
# ---------- python_script_2.python (24 lines) ----------
#python nodes in dynamo 1.0
#proposed by Julien Benoit @jbenoit44 
#http://aecuandme.wordpress.com/
import clr
clr.AddReference('ProtoGeometry')
from Autodesk.DesignScript.Geometry import *
# Import RevitAPI
clr.AddReference('RevitAPI')
import Autodesk
#The inputs to this node will be stored as a list in the IN variable.
dataEnteringNode = IN

elements = []
for i in IN[0]:
    elements.append(UnwrapElement(i))

elementIds, idString, guid = [], [], []
for i in elements:
    elementIds.append(i.Id)
    idString.append(i.Id.ToString())
    guid.append(i.UniqueId)
    
#Assign your output to the OUT variable
OUT = elementIds, idString, guid
# ----------------------------------------
code_block_5 = CodeBlock(OUT=python_script_2) { OUT[0]; }
containsItem = List.ContainsItem(list=uniqueItems, item=code_block_5)
filterByBoolMask_2 = List.FilterByBoolMask(list=code_block_2, mask=containsItem)
OverrideProjectionColor = Input(OverrideProjectionColor:bool[])  # Overrides Projection Color To Red Outline
code_block_6 = CodeBlock(passthrough=filterByBoolMask_2.out, waitfor=OverrideProjectionColor) { {passthrough,waitfor}[0]; }
code_block_7 = CodeBlock(item=code_block_6) { DSCore.List.Flatten({item},-1); }
code_block_8 = CodeBlock { DSCore.Color.ByARGB(255,255,0,0); }
python_script_3 = Python(IN[0]=code_block_7, IN[1]=code_block_8)
# ---------- python_script_3.python (59 lines) ----------
#Copyright(c) 2017, john pierson
# @60secondrevit, http://sixtysecondrevit.com
import clr
clr.AddReference('ProtoGeometry')
from Autodesk.DesignScript.Geometry import *

# Import ToDSType(bool) extension method
clr.AddReference("RevitNodes")
import Revit
clr.ImportExtensions(Revit.Elements)

# Import DocumentManager and TransactionManager
clr.AddReference("RevitServices")
import RevitServices
from RevitServices.Persistence import DocumentManager
from RevitServices.Transactions import TransactionManager

from System.Collections.Generic import *

# Import RevitAPI
clr.AddReference("RevitAPI")
import Autodesk

doc = DocumentManager.Instance.CurrentDBDocument
uiapp = DocumentManager.Instance.CurrentUIApplication
app = uiapp.Application

#The inputs to this node will be stored as a list in the IN variable.
dataEnteringNode = IN

#unwrap all elements to use with API
elements = []
for i in IN[0]:
	elements.append(UnwrapElement(i))

#create graphic overrides properties
gSettings = Autodesk.Revit.DB.OverrideGraphicSettings()
#deconstruct DS Color Object and convert to RevitAPI color
dsColor = IN[1]
colRed = dsColor.Red
colGreen = dsColor.Green
colBlue = dsColor.Blue
color = Autodesk.Revit.DB.Color(colRed, colGreen, colBlue)
#set Projection Line color
gSettings.SetProjectionLineColor(color)

# "Start" the transaction
TransactionManager.Instance.EnsureInTransaction(doc)

#apply color override to elements in an input list
for i in elements:
	id = i.Id
	doc.ActiveView.SetElementOverrides(id, gSettings)

# "End" the transaction
TransactionManager.Instance.TransactionTaskDone()

#Assign your output to the OUT variable
OUT = IN[0]
# ----------------------------------------
Projection_Color = Output(python_script_3)
OverrideFillColor = Input(OverrideFillColor:bool[])  # Overrides Fill Color To Red Solid Fill Pattern
code_block_9 = CodeBlock(passthrough=filterByBoolMask_2.out, waitfor=OverrideFillColor) { {passthrough,waitfor}[0]; }
FillPattern = Input(FillPattern:var[])  # Select a Fill Pattern
python_script_4 = Python(IN[0]=code_block_9, IN[1]=code_block_8, IN[2]=FillPattern)
# ---------- python_script_4.python (77 lines) ----------
import clr
clr.AddReference('ProtoGeometry')
from Autodesk.DesignScript.Geometry import *

# Import ToDSType(bool) extension method
clr.AddReference("RevitNodes")
import Revit
clr.ImportExtensions(Revit.Elements)

# Import DocumentManager and TransactionManager
clr.AddReference("RevitServices")
import RevitServices
from RevitServices.Persistence import DocumentManager
from RevitServices.Transactions import TransactionManager

from System.Collections.Generic import *

# Import RevitAPI
clr.AddReference("RevitAPI")
import Autodesk
from Autodesk.Revit.DB import *

doc = DocumentManager.Instance.CurrentDBDocument
uiapp = DocumentManager.Instance.CurrentUIApplication
app = uiapp.Application

import sys
pyt_path = r'C:\Program Files (x86)\IronPython 2.7\Lib'
sys.path.append(pyt_path)

#The inputs to this node will be stored as a list in the IN variable.
dataEnteringNode = IN

def ProcessList(_func, _list):
    return map( lambda x: ProcessList(_func, x) if type(x)==list else _func(x), _list )

def Unwrap(e):
	return UnwrapElement(e)

def ConvertColor(e):
	return Autodesk.Revit.DB.Color(e.Red, e.Green, e.Blue)

def OverrideColorPattern(e, c, f):
	gSettings = OverrideGraphicSettings()
	gSettings.SetProjectionFillColor(c)
	gSettings.SetProjectionFillPatternId(f.Id)
	gSettings.SetCutFillColor(c)
	gSettings.SetCutFillPatternId(f.Id)
	doc.ActiveView.SetElementOverrides(e.Id, gSettings)
	return e
	
elements = ProcessList(Unwrap, IN[0])

colors = ConvertColor(IN[1])

fillPat = UnwrapElement(IN[2])

try:
	errorReport = None
	TransactionManager.Instance.EnsureInTransaction(doc)
	
	test = []
	for i in elements:
		test.append(OverrideColorPattern(i, colors, fillPat))
		
	TransactionManager.Instance.TransactionTaskDone()
except:
	# if error accurs anywhere in the process catch it
	import traceback
	errorReport = traceback.format_exc()


#Assign your output to the OUT variable
if errorReport == None:
	OUT = test
else:
	OUT = errorReport
# ----------------------------------------
Fill_Pattern = Output(python_script_4)
create = List.Create(filterByBoolMask_2.in)
flatten = Flatten(create)
current = Document.Current()
activeView = Document.ActiveView(current)
python_script_5 = Python(IN[0]=flatten, IN[1]=activeView)
# ---------- python_script_5.python (28 lines) ----------
import clr
clr.AddReference('RevitAPI')
from Autodesk.Revit.DB import *

clr.AddReference("RevitNodes")
import Revit
clr.ImportExtensions(Revit.Elements)

clr.AddReference("RevitServices")
import RevitServices
from RevitServices.Persistence import DocumentManager
from RevitServices.Transactions import TransactionManager

doc = DocumentManager.Instance.CurrentDBDocument
items = UnwrapElement(IN[0])
view = UnwrapElement(IN[1])
booleans = []

override = OverrideGraphicSettings()

TransactionManager.Instance.EnsureInTransaction(doc)
for item in items:
	try:
		view.SetElementOverrides(item.Id, override)
		booleans.append(True)
	except: booleans.append(False)
TransactionManager.Instance.TransactionTaskDone()
OUT = (items,view,booleans)
# ----------------------------------------
code_block_10 = CodeBlock(seq=python_script_5) { seq[0]; seq[1]; seq[2]; }
python_script_6 = Python(IN[0]=filterByBoolMask_2.in, IN[1]=code_block_10.out0)
# ---------- python_script_6.python (4 lines) ----------
check = IN[0]
items = IN[1]
if isinstance(check, (list)): OUT = items
else: OUT = items[0]
# ----------------------------------------
python_script_7 = Python(IN[0]=filterByBoolMask_2.in, IN[1]=code_block_10.out2)  # same code as python_script_6
