# Dynamo custom node Length Of Varying Bars.dyf (Dynamo 1.3.3.4111)
# category: AKP Tools.Rebar
# Gets the length of induvidual straight rebars in a varying set

all_elements_in_active_view = ElementsInView()
string_from_object = FromObject(all_elements_in_active_view)
code_block = CodeBlock { "Rebar"; }
eq = string_from_object == code_block
filterByBoolMask = List.FilterByBoolMask(list=all_elements_in_active_view, mask=eq)
code_block_2 = CodeBlock { "Bar Length"; }
getParameterValueByName = Element.GetParameterValueByName(element=filterByBoolMask.in, parameterName=code_block_2)
code_block_3 = CodeBlock { ""; }
eq_2 = getParameterValueByName == code_block_3
filterByBoolMask_2 = List.FilterByBoolMask(list=filterByBoolMask.in, mask=eq_2)
RunIt = Input(RunIt:bool=false)  # Set True to Run Node,Currently only works for Straight Rebars
python = Python(IN[0]=filterByBoolMask_2.in, IN[1]=RunIt)
# ---------- python.python (63 lines) ----------
#  By Ashwin Kumar

import clr

clr.AddReference('RevitAPI')
from Autodesk.Revit.DB import *
from Autodesk.Revit.DB.Structure import *
import Autodesk

clr.AddReference('ProtoGeometry')
from Autodesk.DesignScript.Geometry import *

clr.AddReference('RevitNodes')
import Revit
clr.ImportExtensions(Revit.GeometryConversion)
clr.ImportExtensions(Revit.Elements)

clr.AddReference('RevitServices')
import RevitServices
from RevitServices.Persistence import DocumentManager
from RevitServices.Transactions import TransactionManager
from System.Collections.Generic import *

rebars = UnwrapElement(IN[0])

runit = IN[1]

mlist = []



for reba in rebars:

	if runit == True:

		mpo = MultiplanarOption.IncludeAllMultiplanarCurves
		numOfBars = reba.NumberOfBarPositions

		revitcurves = []
	
		for i in range(numOfBars):
			
			revitcurves.append(reba.GetCenterlineCurves(0,1,1,mpo,i));
		
			centerlineCurves = []
		
		
		
			for c in revitcurves:
	
				for n in c:
			
					centerlineCurves.Add(n.ToProtoType(True));
				
				
		mlist.Add(centerlineCurves);

	else:
	
		pass
	
	
OUT =mlist
# ----------------------------------------
length = Curve.Length(python)
ceiling = Math.Ceiling(length)
Length = Output(ceiling)
