# Dynamo custom node PinOrUnpinAllElementsInView.dyf (Dynamo 1.3.2.2480)
# category: AKP Tools.General
# Sets Pinned Or Unpinned for all Elements in ActiveView

RunIt = Input(RunIt:bool=false)  # Run Script?
Pin = Input(Pin:bool=false)  # Set true to Pin and False to unpin All Elements in View
pinOrUnpinElementsinView = Python(IN[0]=RunIt, IN[1]=Pin)
# ---------- pinOrUnpinElementsinView.python (67 lines) ----------
import clr
clr.AddReference('ProtoGeometry')
from Autodesk.DesignScript.Geometry import *
# Import ToDSType(bool) extension method
clr.AddReference("RevitNodes")
import Revit
clr.ImportExtensions(Revit.Elements)
# Import geometry conversion extension methods
clr.ImportExtensions(Revit.GeometryConversion)
# Import DocumentManager and TransactionManager
clr.AddReference("RevitServices")
import RevitServices
from RevitServices.Persistence import DocumentManager
from RevitServices.Transactions import TransactionManager
from System.Collections.Generic import *
# Import RevitAPI
clr.AddReference("RevitAPI")
import Autodesk
from Autodesk.Revit.DB import *

doc = DocumentManager.Instance.CurrentDBDocument
uiapp = DocumentManager.Instance.CurrentUIApplication
app = uiapp.Application

coll = FilteredElementCollector(doc,doc.ActiveView.Id)

elementsinview = coll.WhereElementIsNotElementType().ToElements()

check = IN[0]

pin = IN[1]



newelement = []


# Start Transaction
TransactionManager.Instance.EnsureInTransaction(doc)


if check == True:

	try:

		for element in elementsinview:	
		
			Element.Pinned.SetValue(element,IN[1])
		
			if IN[1] == True:
		
				status = "Pinned"
			
			else:
		
				status = "Unpinned"
		
	except:
	
			pass
			
	

TransactionManager.Instance.TransactionTaskDone()


OUT= status
# ----------------------------------------
Result = Output(pinOrUnpinElementsinView)
