# Dynamo custom node Python Template.dyf (Dynamo 1.3.2.2480)
# category: AKP Tools.Python
# Python Template With All Libraries loaded

IN = Input()
python_template = Python(IN[0]=IN)
# ---------- python_template.python (31 lines) ----------
import clr
clr.AddReference('ProtoGeometry')
clr.AddReference('ProtoGeometry')
clr.AddReference("RevitNodes")
clr.AddReference("RevitServices")
clr.AddReference("RevitAPI")
import Revit
import System
import RevitServices
import Autodesk
from Revit.Elements import *
from Autodesk.DesignScript.Geometry import *
from Autodesk.Revit.DB import *
from RevitServices.Persistence import DocumentManager
from RevitServices.Transactions import TransactionManager
clr.ImportExtensions(Revit.Elements)
clr.ImportExtensions(Revit.GeometryConversion)

doc = DocumentManager.Instance.CurrentDBDocument
uiapp = DocumentManager.Instance.CurrentUIApplication
app = uiapp.Application

Elements = IN[0]

TransactionManager.Instance.EnsureInTransaction(doc)


TransactionManager.Instance.TransactionTaskDone()


OUT = 0
# ----------------------------------------
OUT = Output(python_template)
