# Dynamo custom node Rebar Visibility Control.dyf (Dynamo 1.3.2.2480)
# category: AKP Tools.Rebar
# Set Rebar Solid Or unobstructed in Current View

SetSolid = Input(SetSolid:bool=false)
code_block = CodeBlock(solid=SetSolid) { solid; }
SetUnobstructed = Input(SetUnobstructed:bool=false)
code_block_2 = CodeBlock(Unobstructed=SetUnobstructed) { Unobstructed; }
python_script = Python(IN[0]=code_block, IN[1]=code_block_2)
# ---------- python_script.python (75 lines) ----------
import clr

clr.AddReference('RevitAPI')
from Autodesk.Revit.DB import *
from Autodesk.Revit.DB.Structure import *

clr.AddReference('RevitAPIUI')
from Autodesk.Revit.UI import *

clr.AddReference('System')
from System.Collections.Generic import List

clr.AddReference('RevitNodes')
import Revit
clr.ImportExtensions(Revit.GeometryConversion)
clr.ImportExtensions(Revit.Elements)

clr.AddReference('RevitServices')
import RevitServices
from RevitServices.Persistence import DocumentManager
from RevitServices.Transactions import TransactionManager

doc = DocumentManager.Instance.CurrentDBDocument
uidoc=DocumentManager.Instance.CurrentUIApplication.ActiveUIDocument




#Preparing input from dynamo to revit

Solidinview = IN[0]

Unobstructedinview = IN[1]

u = []

f = []

collector = FilteredElementCollector(doc)

rebars = collector.OfClass(Rebar).ToElements()

v= doc.ActiveView

#Do some action in a Transaction
TransactionManager.Instance.EnsureInTransaction(doc)

if Solidinview == True:

	for bars in rebars:

		bars.SetSolidInView(v,True)
					
else:

	for bars in rebars:

		bars.SetSolidInView(v,False)
		
if Unobstructedinview == True:

	for bars in rebars:

		bars.SetUnobscuredInView(v,True)
				
else:

	for bars in rebars:

		bars.SetUnobscuredInView(v,False)
				
TransactionManager.Instance.TransactionTaskDone()


OUT = Solidinview,Unobstructedinview
# ----------------------------------------
code_block_3 = CodeBlock(x=python_script) { x[0]; x[1]; }
Solid = Output(code_block_3.out0)
Unobstructed = Output(code_block_3.out1)
