# Dynamo custom node RebarProperties.dyf (Dynamo 1.3.2.2480)
# category: AKP Tools.Rebar
# Properties Of Selected Rebar

RebarElement = Input()  # Select Rebar Element
code_block = CodeBlock(item=RebarElement) { Flatten({item}); }
code_block_2 = CodeBlock { "Style"; "Type"; "Hook At Start"; "Hook At End"; }
create = List.Create(code_block_2.out0, code_block_2.out1, code_block_2.out2, code_block_2.out3)
getParameterValueByName = Element.GetParameterValueByName(element=code_block@L2, parameterName=create, lacing=Longest)

# group: Rebar Hook Type at Start & End
code_block_3 = CodeBlock { 3; }
getItemAtIndex = List.GetItemAtIndex(list=getParameterValueByName, index=code_block_3)
string_from_object = FromObject(getItemAtIndex)
code_block_4 = CodeBlock { "None"; }
eq = string_from_object == code_block_4
code_block_5 = CodeBlock { null; }
if_ = If(test=eq, true=code_block_5, false=getItemAtIndex)
code_block_6 = CodeBlock { 2; }
getItemAtIndex_2 = List.GetItemAtIndex(list=getParameterValueByName, index=code_block_6)
string_from_object_2 = FromObject(getItemAtIndex_2)
code_block_7 = CodeBlock { "None"; }
eq_2 = string_from_object_2 == code_block_7
code_block_8 = CodeBlock { null; }
if_2 = If(test=eq_2, true=code_block_8, false=getItemAtIndex_2)

HookAtEnd = Output(if_)
HookAtStart = Output(if_2)

# group: Rebar Bar Type
code_block_9 = CodeBlock { 1; }
getItemAtIndex_3 = List.GetItemAtIndex(list=getParameterValueByName, index=code_block_9)

BarType = Output(getItemAtIndex_3)

# group: Rebar Style
firstItem = List.FirstItem(getParameterValueByName)
code_block_10 = CodeBlock { 0; }
eq_3 = firstItem == code_block_10
code_block_11 = CodeBlock { "Standard"; "StirrupTie"; }
if_3 = If(test=eq_3, true=code_block_11.out0, false=code_block_11.out1)

RebarStyle = Output(if_3)
code_block_12 = CodeBlock(lst=RebarElement) { Flatten({lst}); }
python_code = Python(IN[0]=RebarElement, IN[1]=code_block_12)
# ---------- python_code.python (81 lines) ----------
import clr

clr.AddReference('RevitAPI')
from Autodesk.Revit.DB import *
from Autodesk.Revit.DB.Structure import *
import Autodesk

clr.AddReference('ProtoGeometry')
from Autodesk.DesignScript.Geometry import *

clr.AddReference('RevitNodes')
import Revit
clr.ImportExtensions(Revit.GeometryConversion)
clr.ImportExtensions(Revit.Elements)

clr.AddReference('RevitServices')
import RevitServices
from RevitServices.Persistence import DocumentManager
from RevitServices.Transactions import TransactionManager
from System.Collections.Generic import *

doc = DocumentManager.Instance.CurrentDBDocument
uiapp = DocumentManager.Instance.CurrentUIApplication
view = doc.ActiveView
app = uiapp.Application


StartHookOrientation=[]
EndHookOrientation=[]

#Convert input from dynamo to revit
rebar = UnwrapElement(IN[0])
rebar1 = [1]

#Set options
mpo = MultiplanarOption.IncludeAllMultiplanarCurves

#Get info from rebar
numOfBars = rebar.NumberOfBarPositions
quantity = rebar.Quantity
layoutRule = rebar.LayoutRule


HostElements=[]
NonHostedRebar=[]

if numOfBars > 1:
	#Find visible bars and get their centerline curves transformed to correct position
	centerlineCurves = []
	for i in range(numOfBars):
		if not rebar.IsBarHidden(view,i):
			posTransform = rebar.GetBarPositionTransform(i)
			revitCurve = [c.CreateTransformed(posTransform) for c in rebar.GetCenterlineCurves(0,0,0,mpo,0)]
			centerlineCurves.append([r.ToProtoType(True) for r in revitCurve])
	
else:
	centerlineCurves = [r.ToProtoType(True) for r in rebar.GetCenterlineCurves(0,0,0,mpo,0)]
	


#get Host Family Instance
for i in IN[1]:
	rebar1=UnwrapElement(i)
	try:
		id=rebar1.GetHostId()
		inst=doc.GetElement.Overloads[Autodesk.Revit.DB.ElementId](id).ToDSType(True)
		HostElements.append(inst)
		
		start=rebar.GetHookOrientation(0)
		end=rebar.GetHookOrientation(1)
		StartHookOrientation.append(start)
		EndHookOrientation.append(end)
		
	except:
		NonHostedRebar.append(i)
	
	
	
	
	
OUT = centerlineCurves,HostElements,StartHookOrientation, EndHookOrientation
# ----------------------------------------
code = CodeBlock(Host=python_code, Hooksrt=python_code, HookEnd=python_code, curves=python_code) { Host[1][0]; Hooksrt[2]; HookEnd[3]; curves[0]; }
byJoinedCurves = PolyCurve.ByJoinedCurves(code.out3)
CentrelineCurves = Output(byJoinedCurves)
endHookorient = FromObject(code.out2)
HookorientEnd = Output(endHookorient)
startHookorient = FromObject(code.out1)
HookorientStart = Output(startHookorient)
RebarHost = Output(code.out0)
