# Dynamo custom node SelectRebarByShape.dyf (Dynamo 1.3.2.2480)
# category: AKP Tools.Rebar
# Selects Rebar Of Specific Shape in ActiveView

all_elements_in_active_view = ElementsInView()
string_from_object = FromObject(all_elements_in_active_view)
code_block = CodeBlock { "Rebar"; }
code_block_2 = CodeBlock(x=string_from_object, y=code_block) { x; y; x==y; }
filterByBoolMask = List.FilterByBoolMask(list=all_elements_in_active_view, mask=code_block_2.out2)
code_block_3 = CodeBlock { "Shape"; }
getParameterValueByName = Element.GetParameterValueByName(element=filterByBoolMask.in, parameterName=code_block_3)
code_block_4 = CodeBlock { "Type Name"; }
getParameterValueByName_2 = Element.GetParameterValueByName(element=getParameterValueByName, parameterName=code_block_4)
ShapeCode = Input()  # Shape to be Selected as String
eq = getParameterValueByName_2 == ShapeCode
filterByBoolMask_2 = List.FilterByBoolMask(list=filterByBoolMask.in, mask=eq)
python_script = Python(IN[0]=filterByBoolMask_2.in)
# ---------- python_script.python (37 lines) ----------
import clr
clr.AddReference('ProtoGeometry')
from Autodesk.DesignScript.Geometry import *

clr.AddReference("RevitNodes")
import Revit
clr.ImportExtensions(Revit.Elements)

clr.ImportExtensions(Revit.GeometryConversion)

clr.AddReference("RevitServices")
import RevitServices
from RevitServices.Persistence import DocumentManager
from RevitServices.Transactions import TransactionManager
from System.Collections.Generic import *

clr.AddReference("RevitAPI")
import Autodesk
from Autodesk.Revit.DB import *

doc = DocumentManager.Instance.CurrentDBDocument
uiapp = DocumentManager.Instance.CurrentUIApplication
app = uiapp.Application
uidoc=DocumentManager.Instance.CurrentUIApplication.ActiveUIDocument

select = []
elements = UnwrapElement(IN[0])
uisel = uidoc.Selection
result = []

for i in elements:
	select.append(i.Id)
	Icollection = List[ElementId](select)
	uisel.SetElementIds(Icollection)
	result.append("Seccess")
	
OUT = result
# ----------------------------------------
Rebars = Output(filterByBoolMask_2.in)
